# Grasshopper definition compas_acoustics_test.ghx (Grasshopper 1.0.8)
# plug-ins: MeshEdit Components, Pufferfish, LunchBox

# ----
# Material from Library
# (should have only one component)
list = ValueList({"CONCRETE": 0, "BRICKWALL": 1, "CARPET": 2, "ACOUSTIC_PLASTER": 3}, selected="CARPET")
list_2 = ValueList({"CONCRETE": 0, "BRICKWALL": 1, "CARPET": 2, "ACOUSTIC_PLASTER": 3}, selected="ACOUSTIC_PLASTER")
list_3 = ValueList({"CONCRETE": 0, "BRICKWALL": 1, "CARPET": 2, "ACOUSTIC_PLASTER": 3}, selected="BRICKWALL")
py3 = Python3Script(select=list_2)  # -> out, material
# ---------- py3: Python ----------
import compas_acoustics as ca

if select == 0:
    material = ca.AcousticMaterial(
        name='concrete',
        absorption_coefficients=[0.01, 0.01, 0.02, 0.02, 0.02, 0.05, 0.05],
        scattering_coefficients=[0.01, 0.01, 0.03, 0.05, 0.1, 0.1, 0.1]
    )
elif select == 1:
    material = ca.AcousticMaterial(
        name='brickwall',
        absorption_coefficients=[0.01, 0.02, 0.02, 0.03, 0.03, 0.04, 0.04],
        scattering_coefficients=[0.01, 0.01, 0.03, 0.05, 0.2, 0.25, 0.3]
    )
elif select == 2:
    material = ca.AcousticMaterial(
        name='carpet',
        absorption_coefficients=[0.07, 0.31, 0.49, 0.81, 0.66, 0.54, 0.48],
        scattering_coefficients=0.2
    )
elif select == 3:
    material = ca.AcousticMaterial(
        name='acoustic_plaster',
        absorption_coefficients=[0.17, 0.36, 0.66, 0.65, 0.62, 0.68, 0.80],
        scattering_coefficients=0.2
    )
# ---------- end py3 ----------
py3_2 = Python3Script(select=list_3)  # -> out, material; same code as py3
py3_3 = Python3Script(select=list)  # -> out, material; same code as py3

# ----
# Option B: Create Multiple AcousticObjects with different Materials
# Rhino Geometry
brep = Brep(<brep referenced from the Rhino model>)
debrep = DeconstructBrep(Brep=brep)  # -> Faces, Edges, Vertices
py3_4 = Python3Script(geos=debrep.Faces)  # -> out, ceilings, walls, floors; inputs geos: list
# ---------- py3_4: Python ----------
ceilings = geos[6]
walls = geos[:5]
floors = geos[5]
# ---------- end py3_4 ----------

number_slider = Slider(0.46, range=0.01..3.99)

# ----
# Option A: Create Single AcousticObject with one Material
# Material from Params
panel = Panel("0.01, 0.01, 0.02, 0.02, 0.02, 0.05, 0.05")
py3_5 = Python3Script(absorption=panel, scattering="0.01, 0.01, 0.03, 0.05, 0.1, 0.1, 0.1", name="concrete")  # -> out, material; inputs absorption: String, scattering: String
# ---------- py3_5: Python ----------
import compas_acoustics as ca

# import importlib
# importlib.reload(ca)

absorption = [float(x) for x in absorption.split(",")]
scattering = [float(x) for x in scattering.split(",")]

material = ca.AcousticMaterial(
    name=name,
    absorption_coefficients=absorption,
    scattering_coefficients=scattering,
)
# ---------- end py3_5 ----------

number_slider_2 = Slider(2.2, range=0..10)  # disabled
number_slider_3 = Slider(1, range=0..1)  # disabled
_3dsupershape = _3DSupershape(
    UDivisions=80,
    VDivisions=80,
    MParameter=14.074,
    AParameter=-0.06,
    BParameter=2.75,
    N1Parameter=3.75,
    N2Parameter=-0.48,
    N3Parameter=1.46,
    ScaleParameter=number_slider_2,
    D1Interval=Domain(-3.141592654, 3.141592654),
    D2Interval=Domain(-1.570796327, 1.570796327))  # disabled
triremesh = TriRemesh(Geometry=_3dsupershape, Length=number_slider_3, Iterations=25)  # -> Triangulation, Dual, Creases; disabled
mshclsd = IsMeshClosed(Mesh=triremesh.Triangulation)  # disabled
explode = MeshExplode(Mesh=triremesh.Triangulation, Interpolate=False)  # disabled
pt = Point(Point(0.4868665562, 1.641025576, 1.944516102))  # disabled
py3_6 = Python3Script(meshes=explode, position=pt)  # -> out, is_inside; inputs meshes: list of Mesh, polylines: list of Polyline, position: Point3d; disabled
# ---------- py3_6: Python ----------
import pyroomacoustics as pra
import numpy as np

walls = []
for mesh in meshes:
    pts = np.array([[*vtx] for vtx in mesh.Vertices]).T
    # print (pts)
    walls.append(pra.Wall(pts))

room = pra.Room(walls)



# Test if the point inside the room or not
p = np.array([*position]).T

is_inside = room.is_inside(p, False)
print (room)
print (is_inside)
# ---------- end py3_6 ----------
panel_2 = Panel(py3_6.is_inside)  # disabled

# ----
# Receivers
pt_2 = Point([<point referenced from the Rhino model> x2])
lng = ListLength(List=pt_2)
series = Series(Start=0, Step=1, Count=lng)
dots = DotDisplay(Point=pt_2, Colour=RGB(0, 0, 0), Size=0.1)
concat = Concatenate(FragmentA="receiver_", FragmentB=series)
ca_receiver = Python3Script(position=pt_2, name=concat)  # -> out, receiver; inputs position: Point3d, name: String
# ---------- ca_receiver: Python ----------
from compas_acoustics import Receiver


# position = deepcopy(position)

x, y, z = position
receiver = Receiver(x=x, y=y, z=z, name=name)
# ---------- end ca_receiver ----------

pt_3 = Point(pt_2)
item = ListItem(List=pt_3, Index=0, Wrap=True)  # -> Item, Item1
pdecon = Deconstruct(Point=item.Item1)  # -> XComponent, YComponent, ZComponent
pt_4 = ConstructPoint(XCoordinate=pdecon.XComponent, YCoordinate=pdecon.YComponent, ZCoordinate=number_slider)
merge = Merge(Data1=item.Item, Data2=pt_4)

# ----
# Acoustic Objects
data = Data(py3_4.walls)
lng_2 = ListLength(List=data)
series_2 = Series(Start=0, Step=1, Count=lng_2)
concat_2 = Concatenate(FragmentA="brick_wall_", FragmentB=series_2)
ca_acousticobject = Python3Script(room_geometry=py3_4.ceilings, material=py3.material, name="plaster_ceiling")  # -> out, objects; inputs room_geometry: Mesh, name: String
# ---------- ca_acousticobject: Python ----------
import compas_acoustics as ca
from compas_rhino.conversions import mesh_to_compas

geometry = mesh_to_compas(room_geometry)

objects = ca.AcousticObject(acoustic_geometry=geometry, material=material, name=name)
# ---------- end ca_acousticobject ----------
ca_acousticobject_2 = Python3Script(room_geometry=data, material=py3_2.material, name=concat_2)  # -> out, objects; inputs room_geometry: Mesh, name: String; same code as ca_acousticobject
ca_acousticobject_3 = Python3Script(room_geometry=py3_4.floors, material=py3_3.material, name="carpet floor")  # -> out, objects; inputs room_geometry: Mesh, name: String; same code as ca_acousticobject
merge_2 = Merge(Data1=ca_acousticobject.objects, Data2=ca_acousticobject_2.objects, Data3=ca_acousticobject_3.objects)  # -> flatten(Result)

list_4 = ValueList({"BIDIRECTIONAL": 0, "HYPERCARDIOID": 1, "SUPERCARDIOID": 2, "CARDIOID": 3, "OMNIDIRECTIONAL": 4, "CUSTOM": 5}, selected="CARDIOID")

# ----
# Soruces
crv = Curve([<curve referenced from the Rhino model> x3])
list_5 = ValueList({"BIDIRECTIONAL": 0, "HYPERCARDIOID": 1, "SUPERCARDIOID": 2, "CARDIOID": 3, "OMNIDIRECTIONAL": 4, "CUSTOM": 5}, selected="HYPERCARDIOID")
list_6 = ValueList({"BIDIRECTIONAL": 0, "HYPERCARDIOID": 1, "SUPERCARDIOID": 2, "CARDIOID": 3, "OMNIDIRECTIONAL": 4, "CUSTOM": 5}, selected="CARDIOID")
lng_3 = ListLength(List=crv)
eval = EvaluateCurve(Curve=reparameterize(crv), Parameter="0")  # -> Point, Tangent, Angle
series_3 = Series(Start=0, Step=1, Count=lng_3)
py3_7 = Python3Script(name="10_Orchestral.wav")  # -> out, path; inputs name: String
# ---------- py3_7: Python ----------
import sys
import os

gh_path = ghenv.Component.OnPingDocument().FilePath
dire_path = os.path.dirname(gh_path)
sound_path = os.path.join(dire_path, "sound_files", name)

path = sound_path
# ---------- end py3_7 ----------
py3_8 = Python3Script(name="adult_female_speech.wav")  # -> out, path; inputs name: String; same code as py3_7
py3_9 = Python3Script(name="flute_music.wav")  # -> out, path; inputs name: String; same code as py3_7
merge_3 = Merge(Data1=list_5, Data2=list_6, Data3=list_4)
concat_3 = Concatenate(FragmentA="source_", FragmentB=series_3)
merge_4 = Merge(Data1=py3_8.path, Data2=py3_9.path, Data3=py3_7.path)
ca_source = Python3Script(position=eval.Point, direction=crv, directivity=merge_3, name=concat_3, sound_file=merge_4)  # -> out, source; inputs position: Point3d, direction: Vector3d, directivity: Int32, name: String, sound_file: String
# ---------- ca_source: Python ----------
from compas_acoustics import Source



if directivity == 0:
    dirt = "bidirectional"
elif directivity == 1:
    dirt = "hypercardioid"
elif directivity == 2:
    dirt = "supercardioid"
elif directivity == 3:
    dirt = "cardioid"
elif directivity == 4:
    dirt = "omnidirectional"
else:
    raise ValueError()


x, y, z = position
source = Source(
    name=name,
    x=x,
    y=y,
    z=z,
    directivity=dirt,
    direction=[*direction],
    sound_file=sound_file
)
# ---------- end ca_source ----------

# ----
# Rhino Geometry
brep_2 = Brep(<brep referenced from the Rhino model>)
mesh = MeshBrep(
    Brep=brep_2,
    Settings={GridMaxCount=0, GridMinCount=16, JaggedSeams=False, MaxEdgeLength=0, MinEdgeLength=0.0001, MinTolerance=0, Refine=True, RefineAngle=0, RelativeTolerance=0.65, SimplePlanes=True, Tolerance=0})
tri = Triangulate(Mesh=mesh)  # -> Mesh, Count

points = PointList(Points=pt_2, Size=Slider(0.487, range=0..1))

# ----
# Acoustic Objects
panel_3 = Panel("test_room")
ca_acousticobject_4 = Python3Script(room_geometry=tri.Mesh, material=py3_5.material, name=panel_3)  # -> out, room; inputs room_geometry: Mesh, name: String
# ---------- ca_acousticobject_4: Python ----------
from compas_rhino.conversions import mesh_to_compas
import compas_acoustics as ca

geometry = mesh_to_compas(room_geometry)

room = ca.AcousticObject(acoustic_geometry=geometry, material=material, name=name)
# ---------- end ca_acousticobject_4 ----------

py3_10 = Python3Script(sound_file=py3_7.path)  # -> out; inputs sound_file: String
# ---------- py3_10: Python ----------
import soundfile as sf

if sound_file:
    info = sf.info(sound_file)

    print(f"channel: {info.channels}")
# ---------- end py3_10 ----------
panel_4 = Panel(py3_10)

# ----
# Audio Player
button = Button()
py3_11 = Python3Script(sound=py3_9.path, play=button, stop=Button())  # inputs play: Boolean, stop: Boolean
# ---------- py3_11: Python ----------
import scriptcontext as sc
import soundfile as sf
from compas_acoustics import AudioPlayer

sample_rate = None

if isinstance(sound, str):
    try:
        sample_rate = int(sf.info(sound).samplerate)
    except:
        pass
elif hasattr(sound, "sound_file"):
    sound = sound.sound_file
    try:
        sample_rate = int(sf.info(sound).samplerate)
    except:
        pass
elif hasattr(sound, "shape") and hasattr(sound, "ndim"):
    pass
else:
    sound = None

player_key = "compas_acoustics_player_instance"

if player_key not in sc.sticky:
    sc.sticky[player_key] = AudioPlayer()

player = sc.sticky[player_key]

if play and sound is not None:
    player.play(sound, sample_rate)

if stop:
    player.stop()
# ---------- end py3_11 ----------

# ----
# Scene
panel_5 = Panel("test_scene")
ca_scene = Python3Script(name=panel_5, objects=merge_2, sources=ca_source.source, receivers=ca_receiver.receiver)  # -> out, scene; inputs objects: list, sources: list, receivers: list
# ---------- ca_scene: Python ----------
from compas_acoustics import Scene
from compas_acoustics import AcousticMaterial

import compas_acoustics
from copy import deepcopy



scene = Scene(name=name)
scene.add_acoustic_objects(list(objects))

for source in sources:
    scene.add_source(source)

for receiver in receivers:
    scene.add_receiver(receiver)


########### create acoustic materials
concrete = AcousticMaterial(name='concrete', absorption_coefficients=[0.01, 0.01, 0.02, 0.02, 0.02, 0.05, 0.05], scattering_coefficients=[0.01, 0.01, 0.03, 0.05, 0.1, 0.1, 0.1])
brickwall = AcousticMaterial(name='brickwall', absorption_coefficients=[0.01, 0.02, 0.02, 0.03, 0.03, 0.04, 0.04], scattering_coefficients=[0.1, 0.1, 0.3, 0.5, 0.6, 0.5, 0.8])
carpet = AcousticMaterial(name='carpet', absorption_coefficients=[0.07, 0.31, 0.49, 0.81, 0.66, 0.54, 0.48], scattering_coefficients=0.2)
# ---------- end ca_scene ----------

# ----
# Simulate RIR (ray tracing)
number_slider_4 = Slider(2, range=0..3)
ca_simulation = Python3Script(
    scene=ca_scene.scene,
    sample_rate=48000,
    max_order=number_slider_4,
    n_rays=Slider(1000, range=100..3000),
    air_absorption=True,
    seed=Slider(6, range=0..100))  # -> out, ir_graph; inputs sample_rate: Int32, max_order: Int32, n_rays: Int32, air_absorption: Boolean, seed: Int32
# ---------- ca_simulation: Python ----------
from compas_acoustics import Simulator
from compas.data import json_dumps

simulator = Simulator(scene)
simulator.sampling_rate = sample_rate

irs = simulator.rir_from_ray_tracing(
    image_source_order=max_order,
    n_rays=n_rays,
    air_absorption=air_absorption,
    random_seed=seed
)

ir_graph = simulator.scene.ir_graph
# ---------- end ca_simulation ----------

list_7 = ValueList({"BottomLeft": 3}, selected="BottomLeft")

# ----
# optional
number_slider_5 = Slider(0, range=0..10)  # disabled
number_slider_6 = Slider(1, range=0..10)  # disabled
relay = Relay([number_slider_5, number_slider_6])  # disabled

# ----
# Simulate Rays
number_slider_7 = Slider(2, range=0..10)  # disabled
number_slider_8 = Slider(19, range=0..180)  # disabled
number_slider_9 = Slider(13, range=0..180)  # disabled
number_slider_10 = Slider(37, range=0..100)  # disabled
toggle = BooleanToggle(True)  # disabled
py3_12 = Python3Script(
    scene=ca_scene.scene,
    angle=number_slider_9,
    num_of_rays=number_slider_8,
    reflection_order=number_slider_7,
    include_scattering=toggle,
    seed=number_slider_10)  # -> out, specular_reflections, diffuse_reflections; inputs source_idx: list of Int32, angle: Int32, num_of_rays: Int32, reflection_order: Int32, seed: Int32; disabled
# ---------- py3_12: Python ----------
import ghpythonlib.treehelpers as th

from compas.geometry import Vector, Polyline
import compas_rhino.conversions as cv 
import compas_acoustics as ca


from Grasshopper import DataTree
from Grasshopper.Kernel.Data import GH_Path

########### trace the rays
simulator = ca.Simulator(scene, simulation_platform="pyroomacoustics")
# traced_rays = simulator.trace_rays(n_rays=500, max_reflection_order=reflection_order)

specular_reflections = DataTree[object]()
diffuse_reflections = DataTree[object]()

if source_idx:
    selected_sources = [scene.sources[i] for i in source_idx]
else:
    selected_sources = scene.sources

for i, src in enumerate(selected_sources):
    rayfield = simulator.trace_rays(
        n_rays=num_of_rays,
        max_reflection_order=reflection_order,
        direction=src.direction,
        angle=angle,
        sources=[src],
        include_scattering=include_scattering,
        random_seed=seed
    )

    for j, ray in enumerate(rayfield.rays):
        specular_reflections.Add(cv.polyline_to_rhino(Polyline(ray.points)), GH_Path(i))
        for scat_ray in ray.scattered_reflections:
            diffuse_reflections.Add(cv.polyline_to_rhino(Polyline(scat_ray.points)), GH_Path(i, j))
# ---------- end py3_12 ----------
number_slider_11 = Slider(0, range=0..10)  # disabled
py3_13 = Python3Script(x=number_slider_11)  # -> a; inputs x: Int32; disabled
# ---------- py3_13: Python ----------
a = f"{{{x};?}}"
# ---------- end py3_13 ----------
split = SplitTree(Data=py3_12.diffuse_reflections, Masks=flatten(py3_13))  # -> Positive, Negative; disabled
branch = TreeBranch(Tree=py3_12.specular_reflections, Path=number_slider_11, MaintainPaths=True)  # disabled

# ----
# Plotter2D Settings
py3_14 = Python3Script(
    title_height=Slider(0.56, range=0..1),
    axis_title_height=Slider(0.37, range=0..1),
    label_height=Slider(0.28, range=0..1),
    title_justification=list_7)  # -> out, settings
# ---------- py3_14: Python ----------
from compas_acoustics import Plotter2DSettings
from Rhino.Geometry import TextJustification as tj


settings = Plotter2DSettings(
    title_height=title_height,
    axis_title_height=axis_title_height,
    label_height=label_height,
    # title_justification=title_justification,
)
# ---------- end py3_14 ----------

viewer = ParamViewer(py3_12.specular_reflections)  # disabled
srf = Surface(<surface referenced from the Rhino model>)

# ----
# Deconstruct ir_graph
number_slider_12 = Slider(0, range=0..10)
py3_15 = Python3Script(ir_graph=ca_simulation.ir_graph, receiver_idx=Slider(1, range=0..10))  # -> out, ir_out, source_out, receiver_out, edge_out; inputs receiver_idx: list of Int32
# ---------- py3_15: Python ----------
from Grasshopper import DataTree
from Grasshopper.Kernel.Data import GH_Path
from compas.geometry import Line

ir_out = DataTree[object]()
source_out = DataTree[object]()
receiver_out = DataTree[object]()
edge_out = DataTree[object]()

# 1. Set order of receivers
receiver_list = [
    ir_graph.node_attribute(node, 'data')
    for node in ir_graph.nodes()
    if ir_graph.node_attribute(node, 'type') == 'receiver'
]
receiver_set = {rec.guid for rec in receiver_list}

# 2. Make ir group as {receiver_0: [src_0, ...], ...}
source_group = {}
ir_group = {}

for u, v in ir_graph.edges():
    ir = ir_graph.edge_attribute((u, v), 'data')
    data_u = ir_graph.node_attribute(u, 'data')
    data_v = ir_graph.node_attribute(v, 'data')

    if data_u.guid in receiver_set:
        rec, src = data_u, data_v
    elif data_v.guid in receiver_set:
        rec, src = data_v, data_u
    else:
        continue
    
    source_group.setdefault(rec.guid, []).append(src)
    ir_group.setdefault(rec.guid, []).append(ir)

# 3. Filter receiver, optional
if receiver_idx is None:
    indices = list(range(len(receiver_list)))
elif isinstance(receiver_idx, list):
    indices = receiver_idx
else:
    indices = [receiver_idx]

for idx in indices:
    rec = receiver_list[idx]
    path = GH_Path(idx)

    sources = source_group.get(rec.guid, [])
    irs = ir_group.get(rec.guid, [])

    receiver_out.Add(rec, path)
    source_out.AddRange(sources, path)
    ir_out.AddRange(irs, path)
    edge_out.AddRange([Line(src.position, rec.position) for src in sources], path)
# ---------- end py3_15 ----------
draw = COMPASDraw(cg=py3_15.source_out)  # -> rg
#   port cg: The COMPAS geometry or datastructure to be drawn.
#   port rg: The Rhino geometry object.
# ---------- draw: Python ----------
# r: compas>=2.14.1
"""
Draws COMPAS geometry in Grasshopper.
"""

from typing import Any

import Grasshopper

from compas.scene import SceneObject


class CompasToRhinoGeometry(Grasshopper.Kernel.GH_ScriptInstance):
    def RunScript(self, cg):
        if not cg:
            return None

        return SceneObject(item=cg).draw()
# ---------- end draw ----------
draw_2 = COMPASDraw(cg=py3_15.receiver_out)  # -> rg; same code as draw
draw_3 = COMPASDraw(cg=py3_15.edge_out)  # -> rg; same code as draw

item_2 = ListItem(List=py3_15.ir_out, Index=0, Wrap=True)

# ----
# Analyze RIR
py3_16 = Python3Script(ir=item_2)  # -> out, params
# ---------- py3_16: Python ----------
from compas_acoustics import AcousticAnalyser
from compas_acoustics import AcousticParameter

if ir:
    PARAM_NAMES = ['EDT', 'T20', 'T30', 'C50', 'C80', 'D50', 'DRR', 'Ts', 'STI']

    analyser = AcousticAnalyser(ir.ir)
    analyser.analyse()

    params = [AcousticParameter().from_analyser(analyser, name) for name in PARAM_NAMES]
# ---------- end py3_16 ----------

panel_6 = Panel(py3_16.params)
viewer_2 = ParamViewer(py3_12.diffuse_reflections)  # disabled
planar = IsPlanar(Surface=srf, Interior=True)  # -> Planar, Plane
item_3 = ListItem(List=py3_16.params, Index=Slider(3, range=0..10), Wrap=True)

# ----
# Reload the compas_acoustics module
# every time you change something
# outside Rhino/Grasshopper
button_2 = Button()
py3_17 = Python3Script(reload=button_2)  # inputs reload: Boolean
# ---------- py3_17: Python ----------
# venv rhino_acoustics_workspace
# r: compas
# r: matplotlib
# r: pyroomacoustics
# r: librosa
# r: soundfile
# r: spaudiopy
# r: sofar
# r: pyfar==0.7.5
# r: pyrato

import sys
import os
from compas_rhino import unload_modules


gh_path = ghenv.Component.OnPingDocument().FilePath
dire_path = os.path.dirname(os.path.dirname(gh_path))
target_path = os.path.join(dire_path, "src")

if target_path not in sys.path:
    sys.path.insert(0, target_path)

if reload:
    unload_modules('compas_acoustics')

try:
    import compas_acoustics as ca
except Exception as e:
    raise ValueError(e)
# ---------- end py3_17 ----------

py3_18 = Python3Script(name="mono_viola.wav")  # -> out, path; inputs name: String
# ---------- py3_18: Python ----------
import sys
import os

gh_path = ghenv.Component.OnPingDocument().FilePath
dire_path = os.path.dirname(os.path.dirname(gh_path))
sound_path = os.path.join(
    dire_path,
    "src",
    "compas_acoustics",
    "anechoic_soundfiles_library",
    name
)

path = sound_path
# ---------- end py3_18 ----------
dup = DuplicateData(Data=py3_18.path, Number="2", Order=True)  # -> graft(Data)
dup_2 = DuplicateData(Data=py3_18.path, Number="3", Order=True)
dup_3 = DuplicateData(Data=dup, Number="3", Order=True)
viewer_3 = ParamViewer(dup_3)

# ----
# Deconstruct Param
py3_19 = Python3Script(param=item_3)  # -> out, name, values, overall, frequencies
# ---------- py3_19: Python ----------
name = param.title
values = param.values
overall = param.overall
frequencies = param.frequencies
# ---------- end py3_19 ----------

# ----
# Plot2D
py3_20 = Python3Script(param=item_3, plane=planar.Plane, x_size=Slider(8, range=0..10), y_size=Slider(3.5, range=0..10))  # -> out, title, x_title, y_title, x_labels, y_labels, values, points, polyline, grid; inputs plane: Plane, x_size: Double, y_size: Double
# ---------- py3_20: Python ----------
from compas_acoustics import Plotter2D
from compas_acoustics import Plotter2DSettings
from Grasshopper import DataTree
from Grasshopper.Kernel.Data import GH_Path
import Rhino.Geometry as rg


if param:
    plotter = Plotter2D(param, settings)
    plotter.plot(plane=plane, width=x_size, height=y_size)

    title = plotter.title
    x_title = plotter.x_axis_title
    y_title = plotter.y_axis_title
    x_labels = plotter.x_tick_labels
    y_labels = plotter.y_tick_labels
    values = plotter.data_values

    points = plotter.data_points
    polyline = plotter.data_polyline

    # Draw grid
    grid = DataTree[object]()
    items = [
        plotter.x_axis_line,
        plotter.y_axis_line,
        plotter.x_axis_points,
        plotter.y_axis_points,
    ]

    for i, item in enumerate(items):
        path = GH_Path(i)
        if isinstance(item, list):
            grid.AddRange(item, path)
        else:
            grid.Add(item, path)
# ---------- end py3_20 ----------
galapagos = Galapagos(fitness=py3_19, gene=number_slider)
viewer_4 = ParamViewer(py3_15.ir_out)
panel_7 = Panel(py3_19.name)
panel_8 = Panel(py3_19.values)
panel_9 = Panel(py3_19.overall)
panel_10 = Panel(py3_20.x_title)
panel_11 = Panel(py3_20.y_title)
panel_12 = Panel(py3_20.grid)
geo = Geometry(py3_20.grid)
panel_13 = Panel(py3_19.frequencies)

# ----
# Auralize
panel_14 = Panel("sound_auralized")
py3_21 = Python3Script(irs=py3_15.ir_out, save_file_name=panel_14, multiconvolve=Toggle(False), save=Button())  # -> out, signals_out; inputs irs: tree, save_file_path: String, save_file_name: String, signals: tree, multiconvolve: Boolean, save: Boolean
# ---------- py3_21: Python ----------
from compas_acoustics import Auraliser
import numpy as np
import os
from Grasshopper import DataTree
from Grasshopper.Kernel.Data import GH_Path

############-------######################

def set_save_file_path(save_file_path=None, save_file_name=None, suffix=0):
    if save_file_path:
        base_dir = save_file_path
    else:
        base_dir = os.path.dirname(ghenv.Component.OnPingDocument().FilePath)

    if save_file_name:
        base_filename = save_file_name
    else:
        base_filename = "convolved_sound"
    return os.path.join(base_dir, f"{base_filename}_mic_{suffix}.wav")

################
has_signals = signals is not None and signals.DataCount > 0
if has_signals:
    if irs.BranchCount != signals.BranchCount:
        raise ValueError("DataTree branch count mismatch.")
    if any(len(irs.Branch(i)) != len(signals.Branch(i)) for i in range(irs.BranchCount)):
        raise ValueError("DataTree branch length mismatch.")


signals_out = DataTree[object]()

# 1. Data conversions
for i in range(irs.BranchCount):
    path = irs.Paths[i]

    br = irs.Branch(i)
    sound_files = signals.Branch(i) if has_signals else [ir.source.sound_file for ir in br]

    ir_groups = {}
    sound_groups = {}

    for idx, (IR, sound_file) in enumerate(zip(br, sound_files)):
        receiver_id = str(IR.receiver.guid)

        ir_groups.setdefault(receiver_id, {})
        sound_groups.setdefault(receiver_id, {})
        
        sub_key = f"source_{idx}"

        # ir_data = IR.ir
        ir_data = IR.ir[:, np.newaxis] if IR.ir.ndim == 1 else IR.ir

        ir_groups[receiver_id][sub_key] = {
            'ir': ir_data,
            'sample_rate': IR.sample_rate,
            'ambisonic_order': 0,
            'channel_order': 'acn',
            'normalisation': 'sn3d'
        }

        sound_groups[receiver_id][sub_key] = {
            'filepath': sound_file
        }

    # 2. Construct auraliser(s) and convolve signals
    for i, receiver_id in enumerate(ir_groups.keys()):
        if multiconvolve:
            tasks = [(receiver_id, ir_groups[receiver_id], sound_groups[receiver_id], f"{i}")]
        else:
            tasks = [
                (
                    sub_key,
                    {sub_key: ir_groups[receiver_id][sub_key]},
                    {sub_key: sound_groups[receiver_id][sub_key]},
                    f"{i}_{j}",
                )
                for j, sub_key in enumerate(ir_groups[receiver_id].keys())
            ]
        
        for name, ir_data, sound_data, suffix in tasks:
            auraliser = Auraliser(
                name=name,
                impulse_responses=ir_data,
                anechoic_sounds=sound_data,
                output_format="mono",
                # sample_rate=ir_groups[receiver_id][f"source_{0}"]['sample_rate']
                sample_rate=48000
            )
            convolved_matrix = auraliser.multiconvolution()
            
            signals_out.Add(convolved_matrix, path)

            if save:
                filepath = set_save_file_path(save_file_path, save_file_name, suffix)
                auraliser.export_convolved_sound(filepath, convolved_matrix)
# ---------- end py3_21 ----------

py3_22 = Python3Script()  # -> out, chart; disabled
# ---------- py3_22: Python ----------
from compas_acoustics import ImpulseResponse
import Rhino.Geometry as rg

if isinstance(data, ImpulseResponse):
    array = data.ir

chart = array.tolist()
# ---------- end py3_22 ----------
viewer_5 = ParamViewer(py3_21.signals_out)  # disabled
num = Number(py3_22.chart)  # disabled
number_slider_13 = Slider(6.9, range=0..100)  # disabled
# Analyze RIR
number_slider_14 = Slider(0.001, range=0..0.001)  # disabled
bnd = Bounds(Numbers=num)  # disabled
lng_4 = ListLength(List=num)  # disabled
remap = RemapNumbers(Value=num, Source=bnd, Target=number_slider_13)  # -> Mapped, Clipped; disabled
series_4 = Series(Start=0, Step=number_slider_14, Count=lng_4)  # disabled
item_4 = ListItem(List=py3_21.signals_out, Index=0, Wrap=True)  # -> Item, Item1, Item2

# ----
# Audio Player
button_3 = Button()
py3_23 = Python3Script(sound=item_4.Item, play=button_3, stop=Button())  # inputs play: Boolean, stop: Boolean; same code as py3_11

pt_5 = ConstructPoint(XCoordinate=series_4, YCoordinate=remap.Mapped, ZCoordinate=0)  # disabled
pline = PolyLine(Vertices=pt_5, Closed=False)  # disabled
