# Grasshopper definition gh_plugin_test.ghx (Grasshopper 1.0.8)

# ----
# Material from Library
# (should have only one component)
list = ValueList({"CONCRETE": 0, "BRICKWALL": 1, "CARPET": 2, "ACOUSTIC_PLASTER": 3}, selected="CARPET")
list_2 = ValueList({"CONCRETE": 0, "BRICKWALL": 1, "CARPET": 2, "ACOUSTIC_PLASTER": 3}, selected="ACOUSTIC_PLASTER")
list_3 = ValueList({"CONCRETE": 0, "BRICKWALL": 1, "CARPET": 2, "ACOUSTIC_PLASTER": 3}, selected="BRICKWALL")
py3 = Python3Script(select=list_2)  # -> out, material
# ---------- py3: Python ----------
import compas_acoustics as ca

if select == 0:
    material = ca.AcousticMaterial(
        name='concrete',
        absorption_coefficients=[0.01, 0.01, 0.02, 0.02, 0.02, 0.05, 0.05],
        scattering_coefficients=[0.01, 0.01, 0.03, 0.05, 0.1, 0.1, 0.1]
    )
elif select == 1:
    material = ca.AcousticMaterial(
        name='brickwall',
        absorption_coefficients=[0.01, 0.02, 0.02, 0.03, 0.03, 0.04, 0.04],
        scattering_coefficients=[0.01, 0.01, 0.03, 0.05, 0.2, 0.25, 0.3]
    )
elif select == 2:
    material = ca.AcousticMaterial(
        name='carpet',
        absorption_coefficients=[0.07, 0.31, 0.49, 0.81, 0.66, 0.54, 0.48],
        scattering_coefficients=0.2
    )
elif select == 3:
    material = ca.AcousticMaterial(
        name='acoustic_plaster',
        absorption_coefficients=[0.17, 0.36, 0.66, 0.65, 0.62, 0.68, 0.80],
        scattering_coefficients=0.2
    )
# ---------- end py3 ----------
py3_2 = Python3Script(select=list_3)  # -> out, material; same code as py3
py3_3 = Python3Script(select=list)  # -> out, material; same code as py3

lamcp = LAMCPBridge(enable=Toggle(True))  # -> status; inputs enable: Boolean, port: Int32
#   port enable: Toggle to start (True) or stop (False) the local HTTP server.
#   port port: Port to listen on (loopback only). Defaults to 8765.
#   port status: Current server status string.
# ---------- lamcp: Python ----------
"""
LAMCP Bridge: local HTTP server inside Rhino 8 / Grasshopper CPython.

Exposes `POST /exec` (JSON: `{"code": "...", "timeout": 30}`) which
exec()s `code` and returns
`{"stdout": "...", "stderr": "...", "result": "...", "error": null|str}`.

Pair with the `lamcp` FastMCP server, which translates Claude's
`run_python_script` MCP tool calls into POSTs to this endpoint.

Binds to 127.0.0.1 only. NEVER expose beyond localhost â€” it exec()s
arbitrary Python with full Rhino API access.

LAMCP v0.1.0
"""

import contextlib
import io
import json
import threading
import traceback
from http.server import BaseHTTPRequestHandler
from http.server import HTTPServer

import Grasshopper
import scriptcontext as sc


SHARED_GLOBALS_KEY = "_lamcp_bridge_globals"
SERVER_KEY = "_lamcp_bridge_server"


def _exec_code(code, timeout):
    """Run `code` on the HTTP-server thread and capture stdout/stderr/result.

    NOTE: this is intentionally NOT marshalled to Rhino's UI thread for the
    spike â€” `Rhino.RhinoApp.InvokeOnUiThread` was queueing actions that
    never fired in Rhino 8 CPython. Most read-only RhinoCommon access is
    safe cross-thread; mutations may crash. Add Eto-based marshalling
    back here when we need it.
    """
    out = io.StringIO()
    err = io.StringIO()
    g = sc.sticky.setdefault(SHARED_GLOBALS_KEY, {"__name__": "__lamcp_bridge__"})
    error_text = None
    result_repr = None
    try:
        with contextlib.redirect_stdout(out), contextlib.redirect_stderr(err):
            exec(code, g, g)
            result_repr = repr(g.get("_"))
    except BaseException:
        error_text = traceback.format_exc()

    return {
        "stdout": out.getvalue(),
        "stderr": err.getvalue(),
        "result": result_repr,
        "error": error_text,
    }


class _ExecHandler(BaseHTTPRequestHandler):
    # Silence default request logging so it doesn't clog the Rhino command line.
    def log_message(self, fmt, *args):
        pass

    def _send(self, code, payload):
        body = json.dumps(payload).encode("utf-8")
        self.send_response(code)
        self.send_header("Content-Type", "application/json")
        self.send_header("Content-Length", str(len(body)))
        self.end_headers()
        self.wfile.write(body)

    def do_GET(self):
        if self.path == "/health":
            self._send(200, {"status": "ok"})
        else:
            self._send(404, {"error": "not found"})

    def do_POST(self):
        if self.path != "/exec":
            self._send(404, {"error": "not found"})
            return
        length = int(self.headers.get("Content-Length", "0"))
        try:
            raw = self.rfile.read(length).decode("utf-8")
            body = json.loads(raw)
            code = body.get("code", "")
            timeout = float(body.get("timeout", 30.0))
        except Exception as exc:
            self._send(400, {"error": "bad request: " + repr(exc)})
            return
        result = _exec_code(code, timeout)
        self._send(200, result)


def _start_server(port):
    server = HTTPServer(("127.0.0.1", port), _ExecHandler)
    thread = threading.Thread(
        target=server.serve_forever, daemon=True, name="lamcp-bridge"
    )
    thread.start()
    return {"server": server, "thread": thread, "port": port}


def _stop_server(state):
    try:
        state["server"].shutdown()
        state["server"].server_close()
    except Exception:
        pass


class LamcpBridgeComponent(Grasshopper.Kernel.GH_ScriptInstance):
    def RunScript(self, enable: bool, port: int):
        port = int(port) if port else 8765

        state = sc.sticky.get(SERVER_KEY)

        if not enable:
            if state is not None:
                _stop_server(state)
                del sc.sticky[SERVER_KEY]
            return "stopped"

        # Already running on the requested port: no-op.
        if (
            state is not None
            and state.get("port") == port
            and state["thread"].is_alive()
        ):
            return "listening on http://127.0.0.1:{}".format(port)

        # Port changed or server died: tear down and restart.
        if state is not None:
            _stop_server(state)
            del sc.sticky[SERVER_KEY]

        try:
            sc.sticky[SERVER_KEY] = _start_server(port)
        except OSError as exc:
            ghenv.Component.AddRuntimeMessage(  # noqa: F821
                Grasshopper.Kernel.GH_RuntimeMessageLevel.Error,
                "Failed to bind 127.0.0.1:{}: {}".format(port, exc),
            )
            return "error: {}".format(exc)

        return "listening on http://127.0.0.1:{}".format(port)
# ---------- end lamcp ----------
panel = Panel(lamcp)

# ----
# Option B: Create Multiple AcousticObjects with different Materials
# Rhino Geometry
brep = Brep(<brep referenced from the Rhino model>)
debrep = DeconstructBrep(Brep=brep)  # -> Faces, Edges, Vertices
py3_4 = Python3Script(geos=debrep.Faces)  # -> out, ceilings, walls, floors; inputs geos: list
# ---------- py3_4: Python ----------
ceilings = geos[6]
walls = geos[:5]
floors = geos[5]
# ---------- end py3_4 ----------

py3_5 = Python3Script()  # -> out, material
# ---------- py3_5: Python ----------
from compas_acoustics import MaterialsLibrary

material = MaterialsLibrary().material_from_name("acoustic_plaster")
# ---------- end py3_5 ----------

# ----
# Option A: Create Single AcousticObject with one Material
# Material from Params
panel_2 = Panel("0.01, 0.01, 0.02, 0.02, 0.02, 0.05, 0.05")
mat = Compas_acousticsMaterial(absorption=panel_2, scattering="0.01, 0.01, 0.03, 0.05, 0.1, 0.1, 0.1", name="concrete")  # -> material; inputs absorption: String, scattering: String, name: String
#   port absorption: Comma-separated list of absorption coefficients for each frequency band. e.g. '0.1, 0.2, 0.3, 0.4, 0.5, 0.6, 0.7' for 7 frequency bands.
#   port scattering: Comma-separated list of scattering coefficients for each frequency band. e.g. '0.1, 0.2, 0.3, 0.4, 0.5, 0.6, 0.7' for 7 frequency bands.
#   port name: Name of the material preset in the library (e.g. 'concrete', 'carpet').
#   port material: AcousticMaterial object.
# ---------- mat: Python ----------
"""Create an AcousticMaterial for AcousticObject(s)."""
# flake8: noqa
import Grasshopper
from compas_acoustics.acoustic_material import AcousticMaterial


class CreateMaterial(Grasshopper.Kernel.GH_ScriptInstance):

    def RunScript(self, absorption: str, scattering: str, name: str):
        if absorption is None:
            ghenv.Component.AddRuntimeMessage(
                Grasshopper.Kernel.GH_RuntimeMessageLevel.Warning,
                "Input parameter 'absorption' failed to collect data."
            )
            return
        if name is None:
            ghenv.Component.AddRuntimeMessage(
                Grasshopper.Kernel.GH_RuntimeMessageLevel.Warning,
                "Input parameter 'name' failed to collect data."
            )
            return

        absorption = [float(x) for x in absorption.split(",")]
        scattering = [float(x) for x in scattering.split(",")] if scattering is not None else None

        return AcousticMaterial(
            name=name,
            absorption_coefficients=absorption,
            scattering_coefficients=scattering,
        )
# ---------- end mat ----------

# ----
# Soruces
crv = Curve([<curve referenced from the Rhino model> x3])
directivity = Directivity({"Bidirectional": 0, "Hypercardioid": 1, "Supercardioid": 2, "Cardioid": 3, "Omnidirectional": 4}, selected="Cardioid")
directivity_2 = Directivity({"Bidirectional": 0, "Hypercardioid": 1, "Supercardioid": 2, "Cardioid": 3, "Omnidirectional": 4}, selected="Cardioid")
directivity_3 = Directivity({"Bidirectional": 0, "Hypercardioid": 1, "Supercardioid": 2, "Cardioid": 3, "Omnidirectional": 4}, selected="Hypercardioid")
lng = ListLength(List=crv)
eval = EvaluateCurve(Curve=reparameterize(crv), Parameter="0")  # -> Point, Tangent, Angle
series = Series(Start=0, Step=1, Count=lng)
py3_6 = Python3Script(name="10_Orchestral.wav")  # -> out, path; inputs name: String
# ---------- py3_6: Python ----------
import sys
import os

gh_path = ghenv.Component.OnPingDocument().FilePath
dire_path = os.path.dirname(gh_path)
sound_path = os.path.join(dire_path, "sound_files", name)

path = sound_path
# ---------- end py3_6 ----------
py3_7 = Python3Script(name="adult_female_speech.wav")  # -> out, path; inputs name: String; same code as py3_6
py3_8 = Python3Script(name="flute_music.wav")  # -> out, path; inputs name: String; same code as py3_6
merge = Merge(Data1=directivity_3, Data2=directivity, Data3=directivity_2)
concat = Concatenate(FragmentA="source_", FragmentB=series)
merge_2 = Merge(Data1=py3_7.path, Data2=py3_8.path, Data3=py3_6.path)

# ----
# Receivers
pt = Point([<point referenced from the Rhino model> x2])
lng_2 = ListLength(List=pt)
series_2 = Series(Start=0, Step=1, Count=lng_2)
dots = DotDisplay(Point=pt, Colour=RGB(0, 0, 0), Size=0.1)
concat_2 = Concatenate(FragmentA="receiver_", FragmentB=series_2)

pt_2 = Point(pt)
item = ListItem(List=pt_2, Index=0, Wrap=True)  # -> Item, Item1
pdecon = Deconstruct(Point=item.Item1)  # -> XComponent, YComponent, ZComponent
pt_3 = ConstructPoint(XCoordinate=pdecon.XComponent, YCoordinate=pdecon.YComponent, ZCoordinate=Slider(0.46, range=0.01..3.99))
merge_3 = Merge(Data1=item.Item, Data2=pt_3)

# ----
# Acoustic Objects
data = Data(py3_4.walls)
lng_3 = ListLength(List=data)
series_3 = Series(Start=0, Step=1, Count=lng_3)
concat_3 = Concatenate(FragmentA="brick_wall_", FragmentB=series_3)
ca_acousticobject = Python3Script(room_geometry=py3_4.ceilings, material=py3.material, name="plaster_ceiling")  # -> out, objects; inputs room_geometry: Mesh, name: String
# ---------- ca_acousticobject: Python ----------
import compas_acoustics as ca
from compas_rhino.conversions import mesh_to_compas

geometry = mesh_to_compas(room_geometry)

objects = ca.AcousticObject(acoustic_geometry=geometry, material=material, name=name)
# ---------- end ca_acousticobject ----------
ca_acousticobject_2 = Python3Script(room_geometry=data, material=py3_2.material, name=concat_3)  # -> out, objects; inputs room_geometry: Mesh, name: String; same code as ca_acousticobject
ca_acousticobject_3 = Python3Script(room_geometry=py3_4.floors, material=py3_3.material, name="carpet floor")  # -> out, objects; inputs room_geometry: Mesh, name: String; same code as ca_acousticobject
merge_4 = Merge(Data1=ca_acousticobject.objects, Data2=ca_acousticobject_2.objects, Data3=ca_acousticobject_3.objects)  # -> flatten(Result)

# ----
# Rhino Geometry
brep_2 = Brep(<brep referenced from the Rhino model>)
mesh = MeshBrep(
    Brep=brep_2,
    Settings={GridMaxCount=0, GridMinCount=16, JaggedSeams=False, MaxEdgeLength=0, MinEdgeLength=0.0001, MinTolerance=0, Refine=True, RefineAngle=0, RelativeTolerance=0.65, SimplePlanes=True, Tolerance=0})
tri = Triangulate(Mesh=mesh)  # -> Mesh, Count

points = PointList(Points=pt, Size=Slider(0.487, range=0..1))

# ----
# Acoustic Objects
panel_3 = Panel("test_room")
ca_acousticobject_4 = Python3Script(room_geometry=tri.Mesh, material=mat, name=panel_3)  # -> out, room; inputs room_geometry: Mesh, name: String
# ---------- ca_acousticobject_4: Python ----------
from compas_rhino.conversions import mesh_to_compas
import compas_acoustics as ca

geometry = mesh_to_compas(room_geometry)

room = ca.AcousticObject(acoustic_geometry=geometry, material=material, name=name)
# ---------- end ca_acousticobject_4 ----------

receiver = Compas_acousticsReceiver(position=pt, name=concat_2)  # -> receiver; inputs position: Point3d, name: String
#   port position: Position of the receiver.
#   port name: Name of the receiver.
#   port receiver: Receiver object.
# ---------- receiver: Python ----------
"""Acoustic Receiver object (microphone, human ear, etc.)."""
# flake8: noqa
import Grasshopper
import Rhino
from compas_acoustics import Receiver

# TODO: Implement direction
class CreateReceiver(Grasshopper.Kernel.GH_ScriptInstance):

    def RunScript(self, position: Rhino.Geometry.Point3d, name: str):
        if position is None:
            position = Rhino.Geometry.Point3d(0, 0, 1)
        if name is None:
            name = "my_receiver"

        return Receiver(name, *position)
# ---------- end receiver ----------
source = Compas_acousticsSource(position=eval.Point, direction=crv, directivity=merge, name=concat, sound_file=merge_2)  # -> source; inputs position: Point3d, direction: Vector3d, directivity: Int32, name: String, sound_file: String
#   port position: Position of the source.
#   port direction: Direction of the source.
#   port directivity: Directivity of the source. Default is 4 (Omnidirectional). 0=Cardioid 1=Hypercardioid 2=Supercardioid 3=Subcardioid 4=Omnidirectional
#   port name: Name of the source.
#   port sound_file: Sound file associated with the source.
#   port source: Source object.
# ---------- source: Python ----------
"""Acoustic Source object (speaker, human, etc.)."""
# flake8: noqa
import Grasshopper
import Rhino
from compas_acoustics import Source


class CreateSource(Grasshopper.Kernel.GH_ScriptInstance):

    DIRECTIVITY_MAP = {
        0: "bidirectional",
        1: "hypercardioid",
        2: "supercardioid",
        3: "cardioid",
        4: "omnidirectional"
    }

    def RunScript(self,
            position: Rhino.Geometry.Point3d,
            direction: Rhino.Geometry.Vector3d,
            directivity: int,
            name: str,
            sound_file: str):
        if position is None:
            position = Rhino.Geometry.Point3d(0, 0, 0)
        if direction is None:
            direction = Rhino.Geometry.Vector3d(1, 0, 0)

        if directivity is None:
            dirt = "omnidirectional"
        elif directivity not in self.DIRECTIVITY_MAP.keys():
            ghenv.Component.AddRuntimeMessage(
                Grasshopper.Kernel.GH_RuntimeMessageLevel.Error, "Input parameter 'directivity' is not valid."
            )
            return None
        else:
            dirt = self.DIRECTIVITY_MAP[directivity]

        if name is None:
            name = "my_source"

        return Source(
            name,
            *position,
            directivity=dirt,
            direction=[*direction],
            sound_file=sound_file
        )
# ---------- end source ----------

play = Button()
stop = Button()
player = Compas_acousticsAudioPlayer(sound=py3_8.path, play=play, stop=stop)  # inputs play: Boolean, stop: Boolean
#   port sound: Audio file path, numpy array, or Source object.
#   port play: Play the audio.
#   port stop: Stop the audio.
# ---------- player: Python ----------
"""Play audio files, accepting .wav, numpy arrays, and Source objects."""
# flake8: noqa
import Grasshopper
import System
from compas_acoustics import AudioPlayer
import scriptcontext as sc
import soundfile as sf


class PlayAudio(Grasshopper.Kernel.GH_ScriptInstance):

    def offer_buttons(self):
        component = ghenv.Component
        offered_key = "audio_player_buttons_offered_{}".format(component.InstanceGuid)
        if sc.sticky.get(offered_key):
            return
        sc.sticky[offered_key] = True

        doc = component.OnPingDocument()
        if doc is None:
            return

        targets = [(index, nickname) for index, nickname in ((1, "Play"), (2, "Stop")) if component.Params.Input[index].SourceCount == 0]
        if not targets:
            return

        def deferred(gh_doc):
            base = component.Attributes.Pivot
            for row, (index, nickname) in enumerate(targets):
                input_param = component.Params.Input[index]
                if input_param.SourceCount > 0:
                    continue

                button = Grasshopper.Kernel.Special.GH_ButtonObject()
                button.CreateAttributes()
                button.NickName = nickname
                button.Attributes.Pivot = System.Drawing.PointF(base.X - 180, base.Y - 15 + row * 30)
                gh_doc.AddObject(button, False)
                input_param.AddSource(button)
                button.ExpireSolution(True)

        doc.ScheduleSolution(1, deferred)

    def RunScript(self, sound, play: bool, stop: bool):
        self.offer_buttons()

        sample_rate = None

        if sound is None:
            return

        if isinstance(sound, str):  # file path
            try:
                sample_rate = sf.info(sound).samplerate
            except:
                pass
        elif hasattr(sound, "sound_file"):  # Source object
            sound = sound.sound_file
            try:
                sample_rate = sf.info(sound).samplerate
            except:
                pass
        elif hasattr(sound, "shape") and hasattr(sound, "ndim"):  # numpy array
            pass
        else:
            ghenv.Component.AddRuntimeMessage(
                Grasshopper.Kernel.GH_RuntimeMessageLevel.Error, "Input parameter 'sound' is not valid."
            )
            return

        player_key = "player"
        if player_key not in sc.sticky:
            sc.sticky[player_key] = AudioPlayer()

        player = sc.sticky[player_key]

        if play:
            player.play(sound, sample_rate)
        if stop:
            player.stop()
# ---------- end player ----------

# ----
# Scene
panel_4 = Panel("test_scene")
ca_scene = Python3Script(name=panel_4, objects=merge_4, sources=source, receivers=receiver)  # -> out, scene; inputs objects: list, sources: list, receivers: list
# ---------- ca_scene: Python ----------
from compas_acoustics import Scene
from compas_acoustics import AcousticMaterial

import compas_acoustics
from copy import deepcopy



scene = Scene(name=name)
scene.add_acoustic_objects(list(objects))

for source in sources:
    scene.add_source(source)

for receiver in receivers:
    scene.add_receiver(receiver)


########### create acoustic materials
concrete = AcousticMaterial(name='concrete', absorption_coefficients=[0.01, 0.01, 0.02, 0.02, 0.02, 0.05, 0.05], scattering_coefficients=[0.01, 0.01, 0.03, 0.05, 0.1, 0.1, 0.1])
brickwall = AcousticMaterial(name='brickwall', absorption_coefficients=[0.01, 0.02, 0.02, 0.03, 0.03, 0.04, 0.04], scattering_coefficients=[0.1, 0.1, 0.3, 0.5, 0.6, 0.5, 0.8])
carpet = AcousticMaterial(name='carpet', absorption_coefficients=[0.07, 0.31, 0.49, 0.81, 0.66, 0.54, 0.48], scattering_coefficients=0.2)
# ---------- end ca_scene ----------

# ----
# Simulate RIR (ray tracing)
number_slider = Slider(2, range=0..3)
ca_simulation = Python3Script(
    scene=ca_scene.scene,
    sample_rate=48000,
    max_order=number_slider,
    n_rays=Slider(1000, range=100..3000),
    air_absorption=True,
    seed=Slider(6, range=0..100))  # -> out, ir_graph; inputs sample_rate: Int32, max_order: Int32, n_rays: Int32, air_absorption: Boolean, seed: Int32
# ---------- ca_simulation: Python ----------
from compas_acoustics import Simulator
from compas.data import json_dumps

simulator = Simulator(scene)
simulator.sampling_rate = sample_rate

irs = simulator.rir_from_ray_tracing(
    image_source_order=max_order,
    n_rays=n_rays,
    air_absorption=air_absorption,
    random_seed=seed
)

ir_graph = simulator.scene.ir_graph
# ---------- end ca_simulation ----------

# ----
# optional
number_slider_2 = Slider(0, range=0..10)  # disabled
number_slider_3 = Slider(1, range=0..10)  # disabled
relay = Relay([number_slider_2, number_slider_3])  # disabled

# ----
# Simulate Rays
number_slider_4 = Slider(2, range=0..10)  # disabled
number_slider_5 = Slider(19, range=0..180)  # disabled
number_slider_6 = Slider(13, range=0..180)  # disabled
number_slider_7 = Slider(37, range=0..100)  # disabled
toggle = BooleanToggle(True)  # disabled
py3_9 = Python3Script(
    scene=ca_scene.scene,
    angle=number_slider_6,
    num_of_rays=number_slider_5,
    reflection_order=number_slider_4,
    include_scattering=toggle,
    seed=number_slider_7)  # -> out, specular_reflections, diffuse_reflections; inputs source_idx: list of Int32, angle: Int32, num_of_rays: Int32, reflection_order: Int32, seed: Int32; disabled
# ---------- py3_9: Python ----------
import ghpythonlib.treehelpers as th

from compas.geometry import Vector, Polyline
import compas_rhino.conversions as cv 
import compas_acoustics as ca


from Grasshopper import DataTree
from Grasshopper.Kernel.Data import GH_Path

########### trace the rays
simulator = ca.Simulator(scene, simulation_platform="pyroomacoustics")
# traced_rays = simulator.trace_rays(n_rays=500, max_reflection_order=reflection_order)

specular_reflections = DataTree[object]()
diffuse_reflections = DataTree[object]()

if source_idx:
    selected_sources = [scene.sources[i] for i in source_idx]
else:
    selected_sources = scene.sources

for i, src in enumerate(selected_sources):
    rayfield = simulator.trace_rays(
        n_rays=num_of_rays,
        max_reflection_order=reflection_order,
        direction=src.direction,
        angle=angle,
        sources=[src],
        include_scattering=include_scattering,
        random_seed=seed
    )

    for j, ray in enumerate(rayfield.rays):
        specular_reflections.Add(cv.polyline_to_rhino(Polyline(ray.points)), GH_Path(i))
        for scat_ray in ray.scattered_reflections:
            diffuse_reflections.Add(cv.polyline_to_rhino(Polyline(scat_ray.points)), GH_Path(i, j))
# ---------- end py3_9 ----------
number_slider_8 = Slider(0, range=0..10)  # disabled
py3_10 = Python3Script(x=number_slider_8)  # -> a; inputs x: Int32; disabled
# ---------- py3_10: Python ----------
a = f"{{{x};?}}"
# ---------- end py3_10 ----------
split = SplitTree(Data=py3_9.diffuse_reflections, Masks=flatten(py3_10))  # -> Positive, Negative; disabled
branch = TreeBranch(Tree=py3_9.specular_reflections, Path=number_slider_8, MaintainPaths=True)  # disabled

viewer = ParamViewer(py3_9.specular_reflections)  # disabled
srf = Surface(<surface referenced from the Rhino model>)

# ----
# Deconstruct ir_graph
number_slider_9 = Slider(0, range=0..10)
py3_11 = Python3Script(ir_graph=ca_simulation.ir_graph, receiver_idx=Slider(1, range=0..10))  # -> out, ir_out, source_out, receiver_out, edge_out; inputs receiver_idx: list of Int32
# ---------- py3_11: Python ----------
from Grasshopper import DataTree
from Grasshopper.Kernel.Data import GH_Path
from compas.geometry import Line

ir_out = DataTree[object]()
source_out = DataTree[object]()
receiver_out = DataTree[object]()
edge_out = DataTree[object]()

# 1. Set order of receivers
receiver_list = [
    ir_graph.node_attribute(node, 'data')
    for node in ir_graph.nodes()
    if ir_graph.node_attribute(node, 'type') == 'receiver'
]
receiver_set = {rec.guid for rec in receiver_list}

# 2. Make ir group as {receiver_0: [src_0, ...], ...}
source_group = {}
ir_group = {}

for u, v in ir_graph.edges():
    ir = ir_graph.edge_attribute((u, v), 'data')
    data_u = ir_graph.node_attribute(u, 'data')
    data_v = ir_graph.node_attribute(v, 'data')

    if data_u.guid in receiver_set:
        rec, src = data_u, data_v
    elif data_v.guid in receiver_set:
        rec, src = data_v, data_u
    else:
        continue
    
    source_group.setdefault(rec.guid, []).append(src)
    ir_group.setdefault(rec.guid, []).append(ir)

# 3. Filter receiver, optional
if receiver_idx is None:
    indices = list(range(len(receiver_list)))
elif isinstance(receiver_idx, list):
    indices = receiver_idx
else:
    indices = [receiver_idx]

for idx in indices:
    rec = receiver_list[idx]
    path = GH_Path(idx)

    sources = source_group.get(rec.guid, [])
    irs = ir_group.get(rec.guid, [])

    receiver_out.Add(rec, path)
    source_out.AddRange(sources, path)
    ir_out.AddRange(irs, path)
    edge_out.AddRange([Line(src.position, rec.position) for src in sources], path)
# ---------- end py3_11 ----------
draw = COMPASDraw(cg=py3_11.source_out)  # -> rg
#   port cg: The COMPAS geometry or datastructure to be drawn.
#   port rg: The Rhino geometry object.
# ---------- draw: Python ----------
# r: compas>=2.14.1
"""
Draws COMPAS geometry in Grasshopper.
"""

from typing import Any

import Grasshopper

from compas.scene import SceneObject


class CompasToRhinoGeometry(Grasshopper.Kernel.GH_ScriptInstance):
    def RunScript(self, cg):
        if not cg:
            return None

        return SceneObject(item=cg).draw()
# ---------- end draw ----------
draw_2 = COMPASDraw(cg=py3_11.receiver_out)  # -> rg; same code as draw
draw_3 = COMPASDraw(cg=py3_11.edge_out)  # -> rg; same code as draw

item_2 = ListItem(List=py3_11.ir_out, Index=0, Wrap=True)
analyseir = Compas_acousticsAnalyseImpulseResponse(ir=item_2)  # -> params
#   port ir: ImpulseResponse (IR) object.
#   port params: List of acoustic parameters ('EDT', 'T20', 'T30', 'C50', 'C80', 'D50', 'DRR', 'Ts', 'STI').
# ---------- analyseir: Python ----------
"""Analyse impulse response (IR) and return acoustic parameters such as EDT, T20, C50, etc."""
# flake8: noqa
import Grasshopper
from compas_acoustics.analyser import AcousticAnalyser
from compas_acoustics import AcousticParameter
from compas_acoustics import Defaults


class AnalyseIR(Grasshopper.Kernel.GH_ScriptInstance):
    def RunScript(self, ir):
        if ir is None:
            ghenv.Component.AddRuntimeMessage(Grasshopper.Kernel.GH_RuntimeMessageLevel.Warning, "Input parameter 'ir' failed to collect data.")
            return None

        analyser = AcousticAnalyser(ir.ir)
        analyser.analyse()

        return [AcousticParameter().from_analyser(analyser, name) for name in Defaults().PARAM_NAMES]
# ---------- end analyseir ----------
plot2dsettings = Compas_acousticsPlot2DSettings(title_height=Slider(0.56, range=0..1), axis_title_height=Slider(0.37, range=0..1), label_height=Slider(0.28, range=0..1))  # -> settings; inputs title_height: Double, axis_title_height: Double, label_height: Double
#   port title_height: Height of the chart title.
#   port axis_title_height: Height of the axis titles.
#   port label_height: Height of the axis labels.
#   port settings: Plotter2DSettings object.
# ---------- plot2dsettings: Python ----------
"""Settings for a 2D chart of the acoustic parameter."""
# flake8: noqa
import Grasshopper
from Grasshopper import DataTree
from Grasshopper.Kernel.Data import GH_Path
from compas_acoustics import Plotter2DSettings


class Plot2DSettings(Grasshopper.Kernel.GH_ScriptInstance):
    def RunScript(self,
            title_height: float,
            axis_title_height: float,
            label_height: float):
        return Plotter2DSettings(
            title_height=title_height,
            axis_title_height=axis_title_height,
            label_height=label_height,
        )
# ---------- end plot2dsettings ----------
viewer_2 = ParamViewer(py3_9.diffuse_reflections)  # disabled
planar = IsPlanar(Surface=srf, Interior=True)  # -> Planar, Plane
item_3 = ListItem(List=analyseir, Index=Slider(5, range=0..10), Wrap=True)

py3_12 = Python3Script(reload=Button())  # inputs reload: Boolean
# ---------- py3_12: Python ----------
import sys
import os
from compas_rhino import unload_modules


gh_path = ghenv.Component.OnPingDocument().FilePath
dire_path = os.path.dirname(os.path.dirname(gh_path))
target_path = os.path.join(dire_path, "src")

if target_path not in sys.path:
    sys.path.insert(0, target_path)

if reload:
    unload_modules('compas_acoustics')

try:
    import compas_acoustics as ca
except Exception as e:
    raise ValueError(e)
# ---------- end py3_12 ----------

py3_13 = Python3Script(name="mono_viola.wav")  # -> out, path; inputs name: String
# ---------- py3_13: Python ----------
import sys
import os

gh_path = ghenv.Component.OnPingDocument().FilePath
dire_path = os.path.dirname(os.path.dirname(gh_path))
sound_path = os.path.join(
    dire_path,
    "src",
    "compas_acoustics",
    "anechoic_soundfiles_library",
    name
)

path = sound_path
# ---------- end py3_13 ----------
dup = DuplicateData(Data=py3_13.path, Number="2", Order=True)  # -> graft(Data)
dup_2 = DuplicateData(Data=py3_13.path, Number="3", Order=True)
dup_3 = DuplicateData(Data=dup, Number="3", Order=True)
viewer_3 = ParamViewer(dup_3)

deparam = Compas_acousticsDeconstructParameter(param=item_3)  # -> name, values, overall, frequencies
#   port param: AcousticParameter (AP) object.
#   port name: Nmae of the acoustic parameter.
#   port values: Values of the acoustic parameter.
#   port overall: Overall value of the acoustic parameter.
#   port frequencies: Frequencies of the acoustic parameter.
# ---------- deparam: Python ----------
"""Deconstruct acoustic parameter."""
# flake8: noqa
import Grasshopper
from compas_acoustics.analyser import AcousticAnalyser
from compas_acoustics import AcousticParameter
from compas_acoustics import Defaults


class DeconstructParam(Grasshopper.Kernel.GH_ScriptInstance):
    def RunScript(self, param):
        if param is None:
            ghenv.Component.AddRuntimeMessage(Grasshopper.Kernel.GH_RuntimeMessageLevel.Warning, "Input parameter 'param' failed to collect data.")
            return None
        
        return param.title, param.values, param.overall, param.frequencies
# ---------- end deparam ----------
plot2d = Compas_acousticsPlot2D(param=item_3, plane=planar.Plane, x_size=Slider(8, range=0..10), y_size=Slider(3.5, range=0..10))  # -> title, x_title, y_title, x_labels, y_labels, values, points, polyline, grid; inputs plane: Plane, x_size: Double, y_size: Double
#   port param: AcousticParameter (AP) object.
#   port plane: Plane to draw the chart.
#   port x_size: Width of the chart.
#   port y_size: Height of the chart.
#   port settings: Plotter2DSettings for the chart.
#   port title: Title of the chart.
#   port x_title: Title of the x-axis.
#   port y_title: Title of the y-axis.
#   port x_labels: Labels of the x-axis.
#   port y_labels: Labels of the y-axis.
#   port values: Data values of the acoustic parameter.
#   port points: Data points of the chart.
#   port polyline: Data polyline of the chart.
#   port grid: Grid of the chart.
# ---------- plot2d: Python ----------
"""Create a 2D chart of the acoustic parameter."""
# flake8: noqa
import Grasshopper
from Grasshopper import DataTree
from Grasshopper.Kernel.Data import GH_Path
import Rhino
from compas_acoustics import Plotter2D


class Plot2D(Grasshopper.Kernel.GH_ScriptInstance):
    def RunScript(self,
            param,
            plane: Rhino.Geometry.Plane,
            x_size: float,
            y_size: float,
            settings):
        if param is None:
            ghenv.Component.AddRuntimeMessage(Grasshopper.Kernel.GH_RuntimeMessageLevel.Warning, "Input parameter 'param' failed to collect data.")
            return None

        plotter = Plotter2D(param, settings)
        plotter.plot(plane=plane, width=x_size, height=y_size)

        title = plotter.title
        x_title = plotter.x_axis_title
        y_title = plotter.y_axis_title
        x_labels = plotter.x_tick_labels
        y_labels = plotter.y_tick_labels
        values = plotter.data_values

        points = plotter.data_points
        polyline = plotter.data_polyline

        # Draw grid
        grid = DataTree[object]()
        items = [
            plotter.x_axis_line,
            plotter.y_axis_line,
            plotter.x_axis_points,
            plotter.y_axis_points,
        ]

        for i, item in enumerate(items):
            path = GH_Path(i)
            if isinstance(item, list):
                grid.AddRange(item, path)
            else:
                grid.Add(item, path)
        
        return title, x_title, y_title, x_labels, y_labels, values, points, polyline, grid
# ---------- end plot2d ----------
galapagos = Galapagos()
viewer_4 = ParamViewer(py3_11.ir_out)
panel_5 = Panel(deparam.name)
panel_6 = Panel(deparam.values)
panel_7 = Panel(deparam.overall)
panel_8 = Panel(deparam.frequencies)

# ----
# Auralize
panel_9 = Panel("sound_auralized")
py3_14 = Python3Script(irs=py3_11.ir_out, save_file_name=panel_9, multiconvolve=Toggle(False), save=Button())  # -> out, signals_out; inputs irs: tree, save_file_path: String, save_file_name: String, signals: tree, multiconvolve: Boolean, save: Boolean
# ---------- py3_14: Python ----------
from compas_acoustics import Auraliser
import numpy as np
import os
from Grasshopper import DataTree
from Grasshopper.Kernel.Data import GH_Path

############-------######################

def set_save_file_path(save_file_path=None, save_file_name=None, suffix=0):
    if save_file_path:
        base_dir = save_file_path
    else:
        base_dir = os.path.dirname(ghenv.Component.OnPingDocument().FilePath)

    if save_file_name:
        base_filename = save_file_name
    else:
        base_filename = "convolved_sound"
    return os.path.join(base_dir, f"{base_filename}_mic_{suffix}.wav")

################
has_signals = signals is not None and signals.DataCount > 0
if has_signals:
    if irs.BranchCount != signals.BranchCount:
        raise ValueError("DataTree branch count mismatch.")
    if any(len(irs.Branch(i)) != len(signals.Branch(i)) for i in range(irs.BranchCount)):
        raise ValueError("DataTree branch length mismatch.")


signals_out = DataTree[object]()

# 1. Data conversions
for i in range(irs.BranchCount):
    path = irs.Paths[i]

    br = irs.Branch(i)
    sound_files = signals.Branch(i) if has_signals else [ir.source.sound_file for ir in br]

    ir_groups = {}
    sound_groups = {}

    for idx, (IR, sound_file) in enumerate(zip(br, sound_files)):
        receiver_id = str(IR.receiver.guid)

        ir_groups.setdefault(receiver_id, {})
        sound_groups.setdefault(receiver_id, {})
        
        sub_key = f"source_{idx}"

        # ir_data = IR.ir
        ir_data = IR.ir[:, np.newaxis] if IR.ir.ndim == 1 else IR.ir

        ir_groups[receiver_id][sub_key] = {
            'ir': ir_data,
            'sample_rate': IR.sample_rate,
            'ambisonic_order': 0,
            'channel_order': 'acn',
            'normalisation': 'sn3d'
        }

        sound_groups[receiver_id][sub_key] = {
            'filepath': sound_file
        }

    # 2. Construct auraliser(s) and convolve signals
    for i, receiver_id in enumerate(ir_groups.keys()):
        if multiconvolve:
            tasks = [(receiver_id, ir_groups[receiver_id], sound_groups[receiver_id], f"{i}")]
        else:
            tasks = [
                (
                    sub_key,
                    {sub_key: ir_groups[receiver_id][sub_key]},
                    {sub_key: sound_groups[receiver_id][sub_key]},
                    f"{i}_{j}",
                )
                for j, sub_key in enumerate(ir_groups[receiver_id].keys())
            ]
        
        for name, ir_data, sound_data, suffix in tasks:
            auraliser = Auraliser(
                name=name,
                impulse_responses=ir_data,
                anechoic_sounds=sound_data,
                output_format="mono",
                # sample_rate=ir_groups[receiver_id][f"source_{0}"]['sample_rate']
                sample_rate=48000
            )
            convolved_matrix = auraliser.multiconvolution()
            
            signals_out.Add(convolved_matrix, path)

            if save:
                filepath = set_save_file_path(save_file_path, save_file_name, suffix)
                auraliser.export_convolved_sound(filepath, convolved_matrix)
# ---------- end py3_14 ----------

py3_15 = Python3Script()  # -> out, chart; disabled
# ---------- py3_15: Python ----------
from compas_acoustics import ImpulseResponse
import Rhino.Geometry as rg

if isinstance(data, ImpulseResponse):
    array = data.ir

chart = array.tolist()
# ---------- end py3_15 ----------
num = Number(py3_15.chart)  # disabled
number_slider_10 = Slider(6.9, range=0..100)  # disabled
viewer_5 = ParamViewer(py3_14.signals_out)
# Analyze RIR
number_slider_11 = Slider(0.001, range=0..0.001)  # disabled
bnd = Bounds(Numbers=num)  # disabled
lng_4 = ListLength(List=num)  # disabled
remap = RemapNumbers(Value=num, Source=bnd, Target=number_slider_10)  # -> Mapped, Clipped; disabled
series_4 = Series(Start=0, Step=number_slider_11, Count=lng_4)  # disabled
item_4 = ListItem(List=py3_14.signals_out, Index=0, Wrap=True)  # -> Item, Item1, Item2
play_2 = Button()
stop_2 = Button()
pt_4 = ConstructPoint(XCoordinate=series_4, YCoordinate=remap.Mapped, ZCoordinate=0)  # disabled
pline = PolyLine(Vertices=pt_4, Closed=False)  # disabled
player_2 = Compas_acousticsAudioPlayer(sound=item_4.Item, play=play_2, stop=stop_2)  # inputs play: Boolean, stop: Boolean; same code as player
